# Grasshopper definition face-by-face_room.gh (Grasshopper 1.0.7)

geo = Geometry(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)
geo_2 = Geometry(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)
geo_3 = Geometry(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)
geo_4 = Geometry([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])
geo_5 = Geometry([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])
geo_6 = Geometry(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)
door = HBDoor(geo=geo_2)  # -> report, doors; plug-in component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
aperture = HBAperture(geo=geo_3)  # -> report, apertures; plug-in component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
shade = HBShade(geo=geo, trans_sch="Always On")  # -> report, shades; plug-in component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
aperture_2 = HBAperture(geo=geo_5)  # -> report, apertures; plug-in component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
face = HBFace(geo=geo_6, name="Office1Face")  # -> report, faces; plug-in component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
intsolid = HBIntersectSolids(solids=flatten(geo_4), run=Toggle(True))  # -> int_solids; plug-in component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
addshade = HBAddShade(hb_obj=aperture.apertures, out_shades=flatten(shade.shades))  # -> hb_obj; plug-in component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
roomsolid = HBRoomFromSolid(geo=flatten(intsolid), name=flatten("Office"), conditioned=True)  # -> report, rooms; plug-in component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
addsubface = HBAddSubface(hb_obj=face.faces, sub_faces=flatten([addshade, door.doors]))  # -> hb_obj; plug-in component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
addsubface_2 = HBAddSubface(hb_obj=roomsolid.rooms, sub_faces=flatten(aperture_2.apertures))  # -> hb_obj; plug-in component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
panel = Panel(roomsolid.rooms)
room = HBRoom(faces=flatten(addsubface), name="Office", conditioned=Toggle(True))  # -> report, room; plug-in component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
solveadj = HBSolveAdjacency(rooms=flatten(addsubface_2), run=Toggle(True))  # -> report, adj_rooms; plug-in component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
vec = Vector(Vector(-3.794784231, 8.021495122, 0))
model = HBModel(rooms=flatten(room.room), north=vec, run=Toggle(True))  # -> report, model; plug-in component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
prevquick = HBPreviewQuick(hb_obj=solveadj.adj_rooms)  # -> geo; plug-in component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
prevall = HBPreviewAll(hb_obj=solveadj.adj_rooms)  # -> geo; plug-in component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
panel_2 = Panel(model.model)
panel_3 = Panel("https://www.energyplus.net/weather-download/north_and_central_america_wmo_region_4/USA/MA/USA_MA_Boston-Logan.Intl.AP.725090_TMY3/all")
downloadweather = LadybugPlus_DownloadWeather(weather_URL=panel_3)  # -> epw_file, stat_file, ddy_file; plug-in component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
toidf = HBModelToIDF(model=model.model, epw_file=downloadweather.epw_file, write=Toggle(True), run=Toggle(False))  # -> report, idf, sql, eio, rdd, html; plug-in component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
