# Grasshopper definition model_creation_workflows.gh (Grasshopper 1.0.7)

# ----
# Object-by-Object Workflow
#            [High Customization]
panel = Panel("Picture Window")
geo = Geometry(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)
geo_2 = Geometry(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)
geo_3 = Geometry(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)
geo_4 = Geometry([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])
geo_5 = Geometry(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)
aperture = HBAperture(geo=geo_2, name=panel)  # -> report, apertures; plug-in component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
aperture_2 = HBAperture(geo=geo_4)  # -> report, apertures; plug-in component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
shade = HBShade(geo=geo, name="Overhang")  # -> report, shades; plug-in component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
face = HBFace(geo=geo_3, name="Tiny House Face")  # -> report, faces; plug-in component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
door = HBDoor(geo=geo_5, name="Front Door")  # -> report, doors; plug-in component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
addshade = HBAddShade(hb_obj=aperture.apertures, out_shades=flatten(shade.shades))  # -> hb_obj; plug-in component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
addsubface = HBAddSubface(hb_obj=flatten(face.faces), sub_faces=flatten([addshade, door.doors, aperture_2.apertures]))  # -> hb_obj; plug-in component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
geo_6 = Geometry(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)
geo_7 = Geometry(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)
shade_2 = HBShade(geo=geo_6)  # -> report, shades; plug-in component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
shade_3 = HBShade(geo=geo_7)  # -> report, shades; plug-in component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
room = HBRoom(faces=flatten(addsubface), name="Tiny House", conditioned=Toggle(True))  # -> report, room; plug-in component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
addshade_2 = HBAddShade(hb_obj=room.room, out_shades=flatten(shade_3.shades), in_shades=flatten(shade_2.shades))  # -> hb_obj; plug-in component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
tiny_house_room = Data(flatten(addshade_2))

# ----
# Solids-to-Rooms Workflow
toggle = BooleanToggle(True)
geo_8 = Geometry([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])
intsolid = HBIntersectSolids(rooms=flatten(geo_8), run=toggle)  # -> int_rooms; plug-in component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
geo_9 = Geometry([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])
aperture_3 = HBAperture(geo=geo_9)  # -> report, apertures; plug-in component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
roomsolid = HBRoomFromSolid(geo=flatten(intsolid), name="Residence", conditioned=True)  # -> report, rooms; plug-in component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
bordershades = HBExtrudedBorderShades(hb_objs=flatten(aperture_3.apertures), depth="0.2")  # -> report, hb_objs; plug-in component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
addsubface_2 = HBAddSubface(hb_obj=flatten(roomsolid.rooms), sub_faces=flatten(bordershades.hb_objs))  # -> hb_obj; plug-in component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
geo_10 = Geometry([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])
solveadj = HBSolveAdjacency(rooms=flatten(addsubface_2), run=toggle)  # -> report, adj_rooms; plug-in component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
shade_4 = HBShade(geo=geo_10, attached=Toggle(True))  # -> report, shades; plug-in component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
house_shades = Data(flatten(shade_4.shades))
house_rooms = Data(flatten(solveadj.adj_rooms))

facparam = HBFacadeParameters(north=0, east=Toggle(False), south=0, west=Toggle(True))  # -> fac_par; plug-in component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

facparam_2 = HBFacadeParameters(north="0.5", east="1", south="0.5", west="1")  # -> fac_par; plug-in component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

facparam_3 = HBFacadeParameters(north="0", east="45", south="0", west="-45")  # -> fac_par; plug-in component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

# ----
# Solids-to-Rooms Workflow
#                [High Automation]
research_lab = Geometry([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])
lab_support = Geometry([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])
conference = Geometry([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])
classroom = Geometry([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])
corridor = Geometry([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])
storage = Geometry([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])
offices = Geometry([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])
wrietup = Geometry(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)
all_rooms = Geometry([offices, wrietup, conference, classroom, corridor, storage, research_lab, lab_support])
roomsolid_2 = HBRoomFromSolid(geo=flatten(all_rooms), name="Lab Building", conditioned=True)  # -> report, rooms; plug-in component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
solveadj_2 = HBSolveAdjacency(rooms=flatten(roomsolid_2.rooms), run=Toggle(True))  # -> report, adj_rooms; plug-in component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
aperturesbyratio = HBAperturesByRatio(hb_objs=flatten(solveadj_2.adj_rooms), ratio="0.35", win_height="2.8")  # -> report, hb_objs; plug-in component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
louvershades = HBLouverShades(
    hb_objs=flatten(aperturesbyratio.hb_objs),
    depth=facparam_2,
    angle=facparam_3,
    vertical=Toggle(True),
    flip_start=facparam)  # -> report, hb_objs; plug-in component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
multiplier = HBSetMultiplier(rooms=louvershades.hb_objs, multiplier="4")  # -> report, rooms; plug-in component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
lab_rooms = Data(flatten(multiplier.rooms))

model = HBModel(rooms=flatten(tiny_house_room))  # -> report, model; plug-in component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

roomattr = HBRoomAttributes({"Display Name": "display_name", "Simulation Name (Identifier)": "identifier", "Multiplier": "multiplier", "Story": "story", "Volume": "volume", "Gross Floor Area": "floor_area", "Exposed Area": "exposed_area", "Exterior Wall Area": "exterior_wall_area", "Exterior Aperture Area": "exterior_aperture_area", "Average Floor Elevation": "average_floor_height"}, selected="Display Name")
roomenergyattr = HBRoomEnergyAttributes({"Program": "properties.energy.program_type.display_name", "Construction Set": "properties.energy.construction_set.display_name", "Is Conditioned": "properties.energy.is_conditioned", "People per Area [ppl/m2]": "properties.energy.people.people_per_area", "Area per Person [m2/ppl]": "properties.energy.people.area_per_person", "Lighting per Area [W/m2]": "properties.energy.lighting.watts_per_area", "Electric Equipment per Area [W/m2]": "properties.energy.electric_equipment.watts_per_area", "Gas Equipment per Area [W/m2]": "properties.energy.gas_equipment.watts_per_area", "Infiltration per Exterior Area [m3/s-m2]": "properties.energy.infiltration.flow_per_exterior_area", "Ventilation per Person [m3/s-ppl]": "properties.energy.ventilation.flow_per_person"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}, selected="Program")
roomradianceattr = HBRoomEnergyAttributes({"Modifier Set": "properties.radiance.modifier_set.display_name"}, selected="Modifier Set")
faceradianceattr = HBFaceEnergyAttributes({"Modifier": "properties.radiance.modifier.display_name", "Modifier Blk": "properties.radiance.modifier_blk.display_name", "Is Opaque": "properties.radiance.is_opaque", "Dynamic Group": "properties.radiance.dynamic_group_identifier", "State Count": "properties.radiance.state_count", "States": "properties.radiance.states"}, selected="Modifier")
faceattr = HBFaceAttributes({"Display Name": "display_name", "Simulation Name (Identifier)": "identifier", "Boundary Condition": "boundary_condition", "Has Parent": "has_parent", "Parent": "parent", "Area": "area", "Perimeter": "perimeter", "Face Type": "type", "Aperture Is Operable": "is_operable", "Door Is Glass": "is_glass"}, selected="Display Name")
faceenergyattr = HBFaceEnergyAttributes({"Construction": "properties.energy.construction.display_name", "Materials": "properties.energy.construction.layers", "R-Value": "properties.energy.construction.r_value", "U-Value": "properties.energy.construction.u_value", "U-Factor": "properties.energy.construction.u_factor", "Solar Transmitance [Unshaded]": "properties.energy.construction.solar_transmittance", "Solar Reflectance [Outside]": "properties.energy.construction.outside_solar_reflectance", "Solar Reflectance [Inside]": "properties.energy.construction.inside_solar_reflectance", "Fraction Area Operable": "properties.energy.vent_opening.fraction_area_operable", "Fraction Height Operable": "properties.energy.vent_opening.fraction_height_operable", "Discharge Coefficient": "properties.energy.vent_opening.discharge_coefficient", "Cross Ventilation": "properties.energy.vent_opening.wind_cross_vent"}, selected="Construction")

# ----
# Create a Model
panel_2 = Panel("Single Family Home")
model_2 = HBModel(rooms=flatten(house_rooms), shades=flatten(house_shades), name=panel_2)  # -> report, model; plug-in component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
deconstructmodel = HBDeconstructModel(model=model_2.model)  # -> rooms, faces, apertures, doors, shades; plug-in component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

# ----
# Edit
# Geometry
scale = HBScale()  # -> hb_objs; plug-in component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
rotate = HBRotate()  # -> hb_objs; plug-in component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
mirror = HBMirror()  # -> hb_objs; plug-in component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
move = HBMove()  # -> hb_objs; plug-in component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
decnstrobj = HBDeconstructObject()  # -> faces, apertures, doors, shades; plug-in component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

# ----
# Visualize
# Geometry
labelrooms = HBLabelRooms()  # -> label_text, base_pts, labels, wire_frame; plug-in component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
lablefaces = HBLabelFaces()  # -> label_text, base_pts, labels, wire_frame; plug-in component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
vizbytype = HBVisualizeByType(hb_objs=model.model)  # -> walls, interior_walls, roofs, ceilings, exterior_floors, interior_floors, air_walls, apertures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; plug-in component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
vizbybc = HBVisualizeByBC()  # -> outdoors, surface, ground, adiabatic, other, wire_frame; plug-in component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
vizquick = HBVisualizeQuick()  # -> geo; plug-in component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
vizwiref = HBVisualizeWireframe()  # -> geo; plug-in component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
vizall = HBVisualizeAll()  # -> geo; plug-in component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

colorroomattr = HBColorRoomAttributes()  # -> mesh, legend, wire_frame, values, colors, vis_set; plug-in component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
colorfaceattr = HBColorFaceAttributes()  # -> mesh, legend, wire_frame, values, colors, vis_set; plug-in component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
