# Grasshopper definition model_serialization.gh (Grasshopper 1.0.8)

# ----
# Create New Model
panel = Panel("Picture Window")
geo = Geometry([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])
geo_2 = Geometry(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)
geo_3 = Geometry(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)
geo_4 = Geometry(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)
geo_5 = Geometry(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)
aperture = HBAperture(geo=geo)  # -> report, apertures; plug-in component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
aperture_2 = HBAperture(geo=geo_3, name=panel)  # -> report, apertures; plug-in component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
face = HBFace(geo=geo_4, name="Tiny House Face")  # -> report, faces; plug-in component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
shade = HBShade(geo=geo_2, name="Overhang")  # -> report, shades; plug-in component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
door = HBDoor(geo=geo_5, name="Front Door")  # -> report, doors; plug-in component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
addshade = HBAddShade(hb_obj=aperture_2.apertures, out_shades=flatten(shade.shades))  # -> hb_obj; plug-in component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
addsubface = HBAddSubface(hb_obj=flatten(face.faces), sub_faces=flatten([addshade, door.doors, aperture.apertures]))  # -> report, hb_obj, unmatched; plug-in component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
geo_6 = Geometry(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)
geo_7 = Geometry(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)
shade_2 = HBShade(geo=geo_6)  # -> report, shades; plug-in component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
shade_3 = HBShade(geo=geo_7)  # -> report, shades; plug-in component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
room = HBRoom(faces=flatten(addsubface.hb_obj), name="Tiny House", conditioned=Toggle(True))  # -> report, room; plug-in component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
addshade_2 = HBAddShade(hb_obj=room.room, out_shades=flatten(shade_2.shades), in_shades=flatten(shade_3.shades))  # -> hb_obj; plug-in component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
model = HBModel(rooms=flatten(addshade_2), name="Tiny House")  # -> report, model; plug-in component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

# ----
# Create Construction
panel_2 = Panel("Generic Triple Pane")
merge = Merge(
    Data1="Generic Low-e Glass",
    Data2="Generic Window Air Gap",
    Data3="Generic Clear Glass",
    Data4="Generic Window Air Gap",
    Data5="Generic Clear Glass")
windowconstr = HBWindowConstruction(name=panel_2, materials=merge)  # -> constr; plug-in component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

objtostr = HBObjectToString(hb_obj=windowconstr)  # -> hb_str; plug-in component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
construction_string_representation = Panel(objtostr)
strtoobj = HBStringToObject(hb_str=objtostr)  # -> hb_obj; plug-in component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
panel_3 = Panel(strtoobj)

dumpgbxml = HBDumpGbXML(model=model.model, dump=Toggle(False))  # -> report, gbxml; plug-in component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
dumpobjects = HBDumpObjects(hb_objs=flatten(model.model), dump=Toggle(False))  # -> report, hb_file; plug-in component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
gbxml_file_path = Panel(dumpgbxml.gbxml)
honeybee_json_file_path = Panel(dumpobjects.hb_file)
loademodel = HBLoadGbXMLOSMIDF(model_file=dumpgbxml.gbxml, load=Toggle(False))  # -> report, model; plug-in component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
loadobjects = HBLoadObjects(hb_file=dumpobjects.hb_file, load=Toggle(False))  # -> report, hb_objs; plug-in component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
